# Grasshopper definition S20.gh (Grasshopper 1.0.7)

opacity = Slider(255, range=0..255)
color = Slider(19, range=0..19)
taper = Slider(0.047, range=-0.2..0.2)
wide = Slider(-1.776, range=-10..10)
number_slider = Slider(16.8, range=0..20)
addition = Addition(A=number_slider, B=wide)
dom = ConstructDomain(DomainStart=0, DomainEnd=1)
range = Range(Domain=dom, Steps=Slider(8, range=0..30))
ellipse = Ellipse(Plane=PlaneXY(0, 0, 0), Radius1=number_slider, Radius2=addition)  # -> reparameterize(Ellipse), Focus1, Focus2
num = Number(range)
curvature = Curvature(Curve=ellipse.Ellipse, Parameter=num)  # -> P, unitize(K), C
python = GhPythonScript(x=num, long=Slider(3.061, range=0..5), round=Slider(3.217, range=0..10), thick=Slider(8.278, range=0..10))  # -> out, a, b, c
# ---------- python: Python ----------
__author__ = "will"
__version__ = "2020.07.08"

import rhinoscriptsyntax as rs

a = ((x-.5)*long)**6

b = ((x-.5)*round)**2 + thick

c = a + thick
# ---------- end python ----------
rev = Reverse(Vector=curvature.K)
multiplication = Multiplication(A=rev, B=python.a)
number_slider_2 = Slider(12, range=0..30)
addition_2 = Addition(A=multiplication, B=curvature.P)
Z = UnitZ(Factor=1)
dom_2 = ConstructDomain(DomainStart=0, DomainEnd=1)
pl = ConstructPlane(Origin=addition_2, XAxis=Z, YAxis=curvature.K)
range_2 = Range(Domain=dom_2, Steps=number_slider_2)
ellipse_2 = Ellipse(Plane=pl, Radius1=python.b, Radius2=python.c)  # -> reparameterize(Ellipse), Focus1, Focus2
split = SplitList(List=range_2, Index=number_slider_2)  # -> graft(ListA), ListB
item = ListItem(List=addition_2, Index=0, Wrap=True)
eval = EvaluateCurve(Curve=ellipse_2.Ellipse, Parameter=split.ListA)  # -> Point, Tangent, Angle
yz = YZPlane(Origin=Point(0, 0, 0))
pl_origin = PlaneOrigin(Base=yz, Origin=item)
intcrv = Interpolate(Vertices=eval.Point, Degree=3, Periodic=True, KnotStyle=1)  # -> flatten(Curve), Length, Domain
split_2 = SplitList(List=ellipse_2.Ellipse, Index=1)  # -> ListA, ListB
netsurf = NetworkSurface(CurvesU=split_2.ListB, CurvesV=intcrv.Curve, Continuity=2)
mirror = Mirror(Geometry=netsurf, Plane=pl_origin)  # -> Geometry, Transform
vec = VectorXYZ(XComponent=0.1, YComponent=0, ZComponent=0)  # -> Vector, Length
number_slider_3 = Slider(0.3, range=0..1)
move = Move(Geometry=mirror.Geometry, Motion=vec.Vector)  # -> Geometry, Transform
join = BrepJoin(Breps=[move.Geometry, netsurf])  # -> Breps, Closed
addition_3 = Addition(A=number_slider_3, B=taper)
taper_2 = Taper(
    Geometry=join.Breps,
    Axis=Line((-30, 0, 0), (80, 0, 0)),
    Start=number_slider_3,
    End=addition_3,
    Flat=False,
    Infinite=False,
    Rigid=False)
mypreview = RGBPreview(G=taper_2, A=opacity, N=color)

# ==== cluster RGBPreview: Custom Preview clustered with RGB module with preset colors
N = ClusterInput()
python = GhPythonScript(N=N)  # -> out, R, G, B
# ---------- python: Python ----------
__author__ = "will"
__version__ = "2020.07.20"

import rhinoscriptsyntax as rs

colors=[(0,0,0),(255,255,255),(115,115,115),(255,0,0),(0,255,0),(0,0,255),(255,255,0),(255,0,255),(0,255,255),(0,162,255),(252,124,21),(124,51,202),(23,151,59),(255,80,90),(255,80,226),(32,214,255),(0,92,0),(0,0,120),(112,255,49),(138,78,0)]

N=int(N)
R = colors[N][0]
G = colors[N][1]
B = colors[N][2]
# ---------- end python ----------
A = ClusterInput()
G = ClusterInput()
rgb = ColourRGB(Alpha=A, Red=python.R, Green=python.G, Blue=python.B)
preview = CustomPreview(Geometry=G, Material=rgb)
